# Dynamo graph Schedules_les9.dyn (Dynamo 2.3.0.5885)

file_path = Filename("..\Tests\Finishing.py")
file_from_path = FileObject(path=file_path)
readText = FileSystem.ReadText(file=file_from_path)
boolean = BoolSelector(false)
python_script_from_string = PythonStringNode(script=readText, IN[0]=boolean)
type = Object.Type(obj=python_script_from_string)
