# Dynamo graph Загатовка.dyn (Dynamo 2.0.2.6826)

file_path = Filename("C:\Dynamo\Schedule_Create")
file_from_path = FileObject(path=file_path)
readText = FileSystem.ReadText(file=file_from_path)
python_script_from_string = PythonStringNode(script=readText)  # unwired: IN[0]
